# Grasshopper definition UR_Milling_Cue_Loop.gh (Grasshopper 1.0.8)
# plug-ins: Heteroptera, Robots, Pufferfish

# ---- group: Linear Rail
rail_brep = Brep(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)
rail_curve = Curve(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)
custom_preview = CustomPreview(
    Geometry=rail_brep,
    Material={diffuse=RGB(242, 242, 242), emission=RGB(73, 73, 73), shine=0.5, specular=RGB(255, 255, 255), transparency=0})

# ---- group: Target Config
create_tool = CreateTool(Name="Probe", TCP=PlaneXY(0, 0, 80), Weight=0, Mesh=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)  # -> Tool, TCP
list = FlagFields({"Shoulder": 1, "Elbow": 2, "Wrist": 4}, selected=[])
speed_parameter = SpeedParameter(Slider(50, range=0..100))
zone_parameter = ZoneParameter(Slider(2, range=0..10))

# ----
curve = Curve(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)
divide_curve = DivideCurve(Curve=curve, Count=29, Kinks=False)  # -> Points, Tangents, Parameters
perp_frame = PerpFrame(Curve=curve, Parameter=divide_curve.Parameters)
list_length = ListLength(List=perp_frame)
division = Division(A=list_length, B=3)
partition_list = PartitionList(List=perp_frame, Size=division)
flip_matrix = FlipMatrix(Data=partition_list)
list_item = ListItem(List=flip_matrix, Index=0, Wrap=True)  # -> flatten(Item), flatten(Item1), flatten(Item2)

# ---- group: Vention Rail URCap Command Center
point = Point(list_item.Item)
point_2 = Point(list_item.Item1)
point_3 = Point(list_item.Item2)
average = Average(Input=point)
average_2 = Average(Input=point_2)
average_3 = Average(Input=point_3)
merge = Merge(Data1=average, Data2=average_2, Data3=average_3)
curve_closest_point = CurveClosestPoint(Point=merge, Curve=rail_curve)  # -> Point, Parameter, Distance
speed_mm_s = Slider(120, range=0..200)
accel_mm_s² = Slider(50, range=0..200)
deconstruct = Deconstruct(Point=curve_closest_point.Point)  # -> XComponent, YComponent, ZComponent
ventionrailurcap_move = Python3Script(axis="2", speed=speed_mm_s, accel=accel_mm_s², pos=deconstruct.XComponent)  # -> out, code; inputs axis: Int32, speed: Double, accel: Double, pos: Double
# ---------- ventionrailurcap_move: Python ----------
AXIS = axis
MECH_GAIN = 157080.0
SOCKET = "MachineMotion1"

speed_units = speed * 100000
accel_units = accel * 1000
pos_units = pos * 1000

code = (
    f'sendString("SET speed_v{AXIS} {speed_units}", "Ack", "{SOCKET}")\n'
    f'sendString("SET acceleration_v{AXIS} {accel_units}", "Ack", "{SOCKET}")\n'
    f'sendString("SET de_move_abs_{AXIS} {pos_units}", "Ack", "{SOCKET}")\n'
    f'sendString("de_move_abs_exec", "Ack", "{SOCKET}")\n'
    f'pollString("isMotionCompleted", "MachineMotion isMotionCompleted = true", "{SOCKET}")'
)
# ---------- end ventionrailurcap_move ----------
customcmd = CustomCommand(Name="MoveRail", Manufacturer="UR", Code=ventionrailurcap_move.code)

# ----
plane_normal = PlaneNormal(Origin=curve_closest_point.Point, ZAxis=Vector(0, 0, 1))

# ----
# UR Milling Cue Loop Basic
# Each target group is sent as a separate program. For each
# one, the nearest point on the rail axis to the group’s center
# sets the robot base, which is passed to the Vention rail
# controller via a custom URCap init command.
# 
# Programs upload sequentially by monitoring runtime_state
# through the RTDE connection. The user easily can toggle
# between simulation and remote control.
# Robot System
list_2 = RobotsLibrary(
    {"AA-KR60", "AA-KR30", "AA-KR60_KR30", "UR10eTrack", "Franka Emika Panda", "Bartlett-IRB120", "Bartlett-IRB1600", "Bartlett-KR6", "Bartlett-KR60-A", "Bartlett-KR60-B", "Bartlett-KR500", "Bartlett-KR60 on track", "Bartlett-UR10", "Bartlett-KR60", "Bartlett-TX200", "Bartlett-TX200L", "Bartlett-RX160", "Bartlett-RX160L", "UR3e", "UR5e", "UR10e", "UR16e", "UR3", "UR5", "UR10", "UR20", "UR30"}, selected="UR10e",
    Type=0)
robot_ip_address = Panel("192.168.1.141")
load_robot_system = LoadRobotSystem(Name=list_2, Base=plane_normal)  # -> graft(RobotSystem)

# ---- group: Target Group 1
deconstruct_plane = DeconstructPlane(Plane=list_item.Item)  # -> Origin, XAxis, YAxis, ZAxis
construct_plane = ConstructPlane(Origin=deconstruct_plane.Origin, XAxis=deconstruct_plane.YAxis, YAxis=deconstruct_plane.ZAxis)
create_target = CreateTarget(Plane=construct_plane, RobConf=list, Tool=create_tool.Tool, Speed=speed_parameter, Zone=zone_parameter, IsCartesian=True)

# ---- group: Target Group 2
deconstruct_plane_2 = DeconstructPlane(Plane=list_item.Item1)  # -> Origin, XAxis, YAxis, ZAxis
construct_plane_2 = ConstructPlane(Origin=deconstruct_plane_2.Origin, XAxis=deconstruct_plane_2.YAxis, YAxis=deconstruct_plane_2.ZAxis)
create_target_2 = CreateTarget(
    Plane=construct_plane_2,
    RobConf=list,
    Tool=create_tool.Tool,
    Speed=speed_parameter,
    Zone=zone_parameter,
    IsCartesian=True)

# ---- group: Target Group 3
deconstruct_plane_3 = DeconstructPlane(Plane=list_item.Item2)  # -> Origin, XAxis, YAxis, ZAxis
construct_plane_3 = ConstructPlane(Origin=deconstruct_plane_3.Origin, XAxis=deconstruct_plane_3.YAxis, YAxis=deconstruct_plane_3.ZAxis)
create_target_3 = CreateTarget(
    Plane=construct_plane_3,
    RobConf=list,
    Tool=create_tool.Tool,
    Speed=speed_parameter,
    Zone=zone_parameter,
    IsCartesian=True)

# ----
target = Entwine(Branch00=create_target, Branch01=create_target_2, Branch02=create_target_3, FlattenInputs=True)

# ---- group: Toolpath Preview
deconstruct_target = DeconstructTarget(Target=target)
center = Center(Geometry=deconstruct_target, forall=True)  # -> flatten(Center), Dimension
enumerator = Enumerator(Object=center.Center)  # -> Numbers, Color

# ----
tree_statistics = TreeStatistics(Tree=target)  # -> Paths, Length, Count
list_indices = ListIndices(List=tree_statistics.Paths)
concatenate = Concatenate(FragmentA="program_", FragmentB=list_indices)  # -> graft(Result)
create_program = CreateProgram(
    Name=simplify(concatenate),
    RobotSystem=simplify(load_robot_system),
    Targets=simplify(target),
    InitCommands=simplify(customcmd),
    StepSize=10)  # -> flatten(Program), Code, flatten(Duration), Warnings, Errors

# ---- group: URTDE Client
# RTDE Client
urrtde_variables = CSharpScript()  # -> A
# ---------- urrtde_variables: C# ----------
// Grasshopper Script Instance
#region Usings

#r "C:\Users\celso\AppData\Roaming\McNeel\Rhinoceros\packages\8.0\Robots\1.9.0\Robots.dll"
using System;
using System.Linq;
using System.Collections;
using System.Collections.Generic;
using System.Drawing;

using Rhino;
using Rhino.Geometry;

using Grasshopper;
using Grasshopper.Kernel;
using Grasshopper.Kernel.Data;
using Grasshopper.Kernel.Types;

using Robots;
#endregion

public class Script_Instance : GH_ScriptInstance
{
    private void RunScript(ref object A)
    {

        A = URRealTimeDataExchange.GetAllVariables()
                                .Select(v => v.Name)
                                .ToList();
    }
}
# ---------- end urrtde_variables ----------
panel = Panel("""0 to 55
78 to 78""")
subset = SubList(List=urrtde_variables, Domain=panel, Wrap=False)  # -> flatten(List), Index
trigger = Trigger(Interval=10, TimerInterval=10, Target=urrtde_client)  # disabled
urrtde_client = CSharpScript(IP=robot_ip_address, N=subset.List)  # -> A, B; inputs IP: String, N: list of String
# ---------- urrtde_client: C# ----------
// Grasshopper Script Instance
#region Usings

#r "C:\Users\celso\AppData\Roaming\McNeel\Rhinoceros\packages\8.0\Robots\1.9.0\Robots.dll"
using System;
using System.Linq;
using System.Collections;
using System.Collections.Generic;
using System.Drawing;

using Rhino;
using Rhino.Geometry;

using Grasshopper;
using Grasshopper.Kernel;
using Grasshopper.Kernel.Data;
using Grasshopper.Kernel.Types;

using Robots;
#endregion

public class Script_Instance : GH_ScriptInstance
{
    private void RunScript(string IP, List<string> N, ref object A, ref object B)
    {
    A = null;     // safe default
    B = null;     // (optional but clean)

    if(_ip != IP)
    {
        _ip = IP;
        Dispose();
    }

    try
    {
        if(_client == null)
        _client = new URRealTimeDataExchange(IP, N);

        _client.ReadOutputs();

        A = _client.Outputs
        .Select(o => $"{o.Name}: {string.Join(", ", o.Values.Select(v => v.ToString("0.###")))}")
        .ToList();

        B = _client.Log;
    }
    catch(Exception e)
    {
        Dispose();
        B = e.Message;
    }
    }


  // <Custom additional code> 
  string _ip;
  URRealTimeDataExchange _client = null;

  void Dispose()
  {
    if(_client != null)
      _client.Dispose();

    _client = null;
  }

  // </Custom additional code> 
}
# ---------- end urrtde_client ----------

# ----
data_dam = DataDam(DataDataA=create_program.Program, BufferDelay=10000000, BufferMode=0)
save_program = SaveProgram(Program=data_dam, Folder="D:/")

# ---- group: Check If Program Is Stopped
list_item_2 = ListItem(List=urrtde_client.A, Index=31, Wrap=True)
get_value_from_string = Python3Script(string=list_item_2)  # -> Integer; inputs string: list of String
# ---------- get_value_from_string: Python ----------
# Input: string (can be a single string or list of strings)
# Output: Integer (single integer or list of integers)

def extract_int(s):
    data_only = s.split(":")[1]          # split and take the part after ':'
    return int(data_only.strip())        # convert to integer

if isinstance(string, list):             # if input is list
    Integer = [extract_int(s) for s in string]
else:                                    # if input is single string
    Integer = extract_int(string)
# ---------- end get_value_from_string ----------
equality = Equality(FirstNumber=get_value_from_string, SecondNumber=1)  # -> Equality, Inequality

# ----
program_sequencer = ProgramSequencer(program_parameter=create_program.Program, value=Slider(0, range=0..0.99999))  # -> tree, result
program_simulation = ProgramSimulation(Program=program_sequencer.tree, Time=program_sequencer.result, Normalized=True)  # -> SystemMeshes, JointRotations, Plane, Index, Time, Program, Errors
list_item_3 = ListItem(List=program_simulation.Plane, Index=7, Wrap=True)
point_4 = Point(list_item_3)

# ---- group: Control Buttons
toggle_simulation_remote = BooleanToggle(False)
upload = Button()
play = Button()
pause = Button()

# ---- group: Button OR Prog Stopped
gate_or = GateOr(A=equality.Equality, B=upload)
event_gate = EventGate(Data=gate_or)  # -> Data, IsNew
panel_2 = Panel(event_gate.Data)

# ---- group: Sequencial Program Incrementation
list_indices_2 = ListIndices(List=create_program.Program)
merge_2 = Merge(Data1="-1", Data2=list_indices_2)
stream_freeze_gate = StreamFreezeGate(Data=merge_2, PassingSwitch=toggle_simulation_remote, Freeze=False)
oilcan = OilCan(DataList=stream_freeze_gate, Reset=upload, Drop=event_gate.Data, DropMode=2)
list_item_4 = ListItem(List=create_program.Program, Index=oilcan, Wrap=False)

# ---- group: Show next target
list_item_5 = ListItem(List=urrtde_client.A, Index=56, Wrap=True)
get_value_from_string_2 = Python3Script(string=list_item_5)  # -> Integer; inputs string: list of String; same code as get_value_from_string
difference = Panel("9")
holding_gate = HoldingGate(Data=oilcan)
deconstruct_target_2 = DeconstructTarget(Target=target)
maximum = Maximum(A=get_value_from_string_2, B=difference)
tree_branch = TreeBranch(Tree=simplify(deconstruct_target_2), Path=holding_gate, MaintainPaths=True)
subtraction = Subtraction(A=maximum, B=difference)
sub_list = SubList(List=tree_branch, Domain=subtraction, Wrap=True)  # -> List, Index
list_item_6 = ListItem(List=tree_branch, Index=subtraction, Wrap=False)
panel_3 = Panel(subtraction)
polyline = PolyLine(Vertices=sub_list.List, Closed=False)
annotation_dot = AnnotationDot(Location=list_item_6, PrimaryText=subtraction, TextHeight=14)
point_5 = Point(list_item_6)

# ----
remote_connection = RemoteConnection(Program=list_item_4, IP=robot_ip_address, Upload=event_gate.Data, Play=play, Pause=pause)

# ---- group: Real-time Monitoring
# runtime_state Guide: 0 = Stopping / Not Running
# 1 = Stopped
# 2 = Running / Playing
# 3 = Pausing
# 4 = Paused
# 5 = Resuming
text = Text(list_item_2)
_31_runtime_state = Panel(text)
list_length_2 = ListLength(List=create_program.Program)
text_2 = Text(list_item_5)
concatenate_2 = Concatenate(FragmentA=holding_gate, FragmentB="/", FragmentA_2=list_length_2, FragmentB_2=" - ", FragmentA_3=get_value_from_string_2)
_78_script_control_line = Panel(text_2)
progindex_lineindex = Panel(concatenate_2)
hh_mm_ss = Python3Script(duration=flatten(create_program.Duration))  # -> total, list_d; inputs duration: list of Double
# ---------- hh_mm_ss: Python ----------
# duration : list_d of durations in minutes (floats)
# Outputs:
# total → summed time HH:MM:SS
# list_d → each duration formatted individually HH:MM:SS

def to_hms(minutes):
    total_seconds = int(minutes * 60)
    h = total_seconds // 3600
    m = (total_seconds % 3600) // 60
    s = total_seconds % 60
    return f"{h:02d}:{m:02d}:{s:02d}"

# Format each duration
list_d = [to_hms(v) for v in duration]

# Sum durations
total_minutes = sum(duration)
total = to_hms(total_minutes)
# ---------- end hh_mm_ss ----------
total_duration = Panel(hh_mm_ss.total)
list_duration = Panel(hh_mm_ss.list_d)

# ---- group: Real-time Preview
list_item_7 = ListItem(List=urrtde_client.A, Index=10, Wrap=True)
holding_gate_2 = HoldingGate(Data=oilcan)
robotsystem_parameter = RobotSystemParameter(load_robot_system)
python_3_script = Python3Script(actual_TCP_pose=list_item_7)  # -> reversed_list; inputs actual_TCP_pose: String
# ---------- python_3_script: Python ----------
# Input: "actual_TCP_pose"
# Output: "reversed_list"

data_only = actual_TCP_pose.split(":")[1] # split after text and select index [1]
parts = data_only.split(",") # split into list
values = [float(p.strip()) for p in parts] # clean extra space 
reversed_values = list(reversed(values)) #reverse to match the strcuture of the following component 
reversed_list = reversed_values # output
# ---------- end python_3_script ----------
tree_branch_2 = TreeBranch(Tree=simplify(robotsystem_parameter), Path=holding_gate_2, MaintainPaths=True)
get_plane = GetPlane(Numbers=python_3_script, RobotSystem=tree_branch_2)

# ---- group: Real-time Monitoring (continued)
text_3 = Text(python_3_script)
degrees = Degrees(Radians=text_3)
_10_actual_tcp_pose_formated = Panel(degrees)

# ----
create_target_4 = CreateTarget(Plane=get_plane, IsCartesian=True)

# ---- group: Real-time Preview (continued)
kinematics = Kinematics(RobotSystem=tree_branch_2, Target=create_target_4, DisplayGeometry=True)  # -> Meshes, Joints, Planes, Errors
custom_preview_2 = CustomPreview(
    Geometry=kinematics.Meshes,
    Material={diffuse=RGB(221, 160, 221), emission=RGB(66, 48, 66), shine=0.5, specular=RGB(255, 255, 255), transparency=0})  # disabled

# ---- group: Preview
stream_filter = StreamFilter(Gate=toggle_simulation_remote, Stream0=program_simulation.SystemMeshes, Stream1=kinematics.Meshes)
simulation = ColourSwatch(SwatchColor=RGB(221, 160, 221))
real_time = ColourSwatch(SwatchColor=RGB(255, 170, 0))
stream_filter_2 = StreamFilter(Gate=toggle_simulation_remote, Stream0=simulation, Stream1=real_time)
custom_preview_3 = CustomPreview(Geometry=stream_filter, Material=stream_filter_2)

# ==== cluster ProgramSequencer
program_parameter = ClusterInput()
program_parameter_2 = ProgramParameter(program_parameter)
list_length = ListLength(List=program_parameter_2)
value = ClusterInput()
remap_numbers = RemapNumbers(Value=value, Source=Domain(0, 1), Target=list_length)  # -> Mapped, Clipped
round = Round(Number=remap_numbers.Mapped)  # -> Nearest, Floor, Ceiling
sift_indices = SiftIndices(List=program_parameter_2, Indices=round.Floor)  # -> AtI, NotI
modulus = Modulus(A=remap_numbers.Mapped, B=1)
clean_tree = CleanTree(RemoveNulls=True, RemoveInvalid=True, RemoveEmpty=True, Tree=sift_indices.AtI)
result = ClusterOutput(modulus)
tree = ClusterOutput(clean_tree)
