# Grasshopper definition UR_Printing_Cue_Loop.gh (Grasshopper 1.0.8)
# plug-ins: Heteroptera, Robots, Pufferfish, Human

# ----
# UR Printing Cue Loop
# Split a toolpath into multiple programs of a selected
# length and upload them sequencially by checking
# the robot's runtime_state through RTDE connection.
# The user can easily toggle between simulation
# view and remote control.
# Robot System
list = RobotsLibrary(
    {"AA-KR60", "AA-KR30", "AA-KR60_KR30", "UR10eTrack", "Franka Emika Panda", "Bartlett-IRB120", "Bartlett-IRB1600", "Bartlett-KR6", "Bartlett-KR60-A", "Bartlett-KR60-B", "Bartlett-KR500", "Bartlett-KR60 on track", "Bartlett-UR10", "Bartlett-KR60", "Bartlett-TX200", "Bartlett-TX200L", "Bartlett-RX160", "Bartlett-RX160L", "UR3e", "UR5e", "UR10e", "UR16e", "UR3", "UR5", "UR10", "UR20", "UR30"}, selected="UR10e",
    Type=0)
load_robot_system = LoadRobotSystem(Name=list, Base=PlaneXY(0, 0, 0))
robot_ip_address = Panel("192.168.1.141")

# ---- group: Target Config
create_tool = CreateTool(Name="Probe", TCP=PlaneXY(0, 0, 80), Weight=0, Mesh=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)  # -> Tool, TCP
list_2 = FlagFields({"Shoulder": 1, "Elbow": 2, "Wrist": 4}, selected=[])
speed_parameter = SpeedParameter(Slider(50, range=0..100))
zone_parameter = ZoneParameter(Slider(1, range=0..10))

# ---- group: Toolpath
brep = Brep(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)
number_slider = Slider(2, range=0..100)
contour = Contour(Shape=brep, Point=Point(0, 0, 0), Direction=Vector(0, 0, 1), Distance=number_slider)
divide_length = DivideLength(Curve=contour, Length=number_slider)  # -> flatten(Points), Tangents, Parameters
flip_plane = FlipPlane(Plane=divide_length.Points, ReverseX=False, ReverseY=False, SwapAxes=True)
polyline = PolyLine(Vertices=divide_length.Points, Closed=False)
custom_preview_lineweights = CustomPreviewLineweights(
    Geometry=polyline,
    Shader={diffuse=RGB(221, 160, 221), emission=RGB(66, 48, 66), shine=0.5, specular=RGB(255, 255, 255), transparency=0},
    Absolute=False)

# ----
cue_size = Slider(2000, range=0..2000)

# ---- group: Partition Target + Extrusion Start & Stop
partition_list = PartitionList(List=flip_plane, Size=cue_size)
list_item = ListItem(List=partition_list, Index=0, Wrap=True)
list_item_2 = ListItem(List=partition_list, Index=-1, Wrap=True)
start = CreateTarget(
    Plane=list_item,
    RobConf=list_2,
    Tool=create_tool.Tool,
    Speed=speed_parameter,
    Zone=zone_parameter,
    Command=null,
    IsCartesian=True)
stop = CreateTarget(
    Plane=list_item_2,
    RobConf=list_2,
    Tool=create_tool.Tool,
    Speed=speed_parameter,
    Zone=zone_parameter,
    Command=null,
    IsCartesian=True)
create_target = CreateTarget(
    Plane=partition_list,
    RobConf=list_2,
    Tool=create_tool.Tool,
    Speed=speed_parameter,
    Zone=zone_parameter,
    IsCartesian=True)
merge = Merge(Data1=start, Data2=stop)
panel = Panel("""0
-1""")
insert_items = InsertItems(List=create_target, Item=merge, Indices=panel, Wrap=True)

# ---- group: Home Position (Beginning & End)
home = Plane(Plane(origin=(30.00004871, -807.3883541, 605), x=(0, 1, 0), y=(1, 0, 0)))
point = Point(home)
preview = Preview(point=point)
create_target_2 = CreateTarget(Plane=home, RobConf=list_2, Tool=create_tool.Tool, Speed=speed_parameter, Zone=zone_parameter, IsCartesian=True)
entwine = Entwine(Branch0X=create_target_2, Branch1X=simplify(insert_items), Branch2X=create_target_2, FlattenInputs=False)  # -> simplify(Result)
path_mapper = PathMapper(entwine, source="{A;B}", target="{path_index}")

# ----
tree_statistics = TreeStatistics(Tree=path_mapper)  # -> Paths, Length, Count
list_indices = ListIndices(List=tree_statistics.Paths)
concatenate = Concatenate(FragmentA="program_", FragmentB=list_indices)
create_program = CreateProgram(Name=graft(concatenate), RobotSystem=graft(load_robot_system), Targets=simplify(path_mapper), StepSize=10)  # -> flatten(Program), Code, flatten(Duration), Warnings, Errors

# ---- group: URTDE Client
# RTDE Client
urrtde_variables = CSharpScript()  # -> A
# ---------- urrtde_variables: C# ----------
// Grasshopper Script Instance
#region Usings

#r "C:\Users\celso\AppData\Roaming\McNeel\Rhinoceros\packages\8.0\Robots\1.9.0\Robots.dll"
using System;
using System.Linq;
using System.Collections;
using System.Collections.Generic;
using System.Drawing;

using Rhino;
using Rhino.Geometry;

using Grasshopper;
using Grasshopper.Kernel;
using Grasshopper.Kernel.Data;
using Grasshopper.Kernel.Types;

using Robots;
#endregion

public class Script_Instance : GH_ScriptInstance
{
    private void RunScript(ref object A)
    {

        A = URRealTimeDataExchange.GetAllVariables()
                                .Select(v => v.Name)
                                .ToList();
    }
}
# ---------- end urrtde_variables ----------
panel_2 = Panel("""0 to 55
78 to 78""")
subset = SubList(List=urrtde_variables, Domain=panel_2, Wrap=False)  # -> flatten(List), Index
trigger = Trigger(Interval=10, TimerInterval=10, Target=urrtde_client)  # disabled
urrtde_client = CSharpScript(IP=robot_ip_address, N=subset.List)  # -> A, B; inputs IP: String, N: list of String
# ---------- urrtde_client: C# ----------
// Grasshopper Script Instance
#region Usings

#r "C:\Users\celso\AppData\Roaming\McNeel\Rhinoceros\packages\8.0\Robots\1.9.0\Robots.dll"
using System;
using System.Linq;
using System.Collections;
using System.Collections.Generic;
using System.Drawing;

using Rhino;
using Rhino.Geometry;

using Grasshopper;
using Grasshopper.Kernel;
using Grasshopper.Kernel.Data;
using Grasshopper.Kernel.Types;

using Robots;
#endregion

public class Script_Instance : GH_ScriptInstance
{
    private void RunScript(string IP, List<string> N, ref object A, ref object B)
    {
    A = null;     // safe default
    B = null;     // (optional but clean)

    if(_ip != IP)
    {
        _ip = IP;
        Dispose();
    }

    try
    {
        if(_client == null)
        _client = new URRealTimeDataExchange(IP, N);

        _client.ReadOutputs();

        A = _client.Outputs
        .Select(o => $"{o.Name}: {string.Join(", ", o.Values.Select(v => v.ToString("0.###")))}")
        .ToList();

        B = _client.Log;
    }
    catch(Exception e)
    {
        Dispose();
        B = e.Message;
    }
    }


  // <Custom additional code> 
  string _ip;
  URRealTimeDataExchange _client = null;

  void Dispose()
  {
    if(_client != null)
      _client.Dispose();

    _client = null;
  }

  // </Custom additional code> 
}
# ---------- end urrtde_client ----------

# ----
program_sequencer = ProgramSequencer(program_parameter=create_program.Program, value=Slider(0, range=0..0.9999))  # -> tree, result

# ---- group: Check If Program Is Stopped
list_item_3 = ListItem(List=urrtde_client.A, Index=31, Wrap=True)
get_value_from_string = Python3Script(string=list_item_3)  # -> Integer; inputs string: list of String
# ---------- get_value_from_string: Python ----------
# Input: string (can be a single string or list of strings)
# Output: Integer (single integer or list of integers)

def extract_int(s):
    data_only = s.split(":")[1]          # split and take the part after ':'
    return int(data_only.strip())        # convert to integer

if isinstance(string, list):             # if input is list
    Integer = [extract_int(s) for s in string]
else:                                    # if input is single string
    Integer = extract_int(string)
# ---------- end get_value_from_string ----------
equality = Equality(FirstNumber=get_value_from_string, SecondNumber=1)  # -> Equality, Inequality

# ----
program_simulation = ProgramSimulation(Program=program_sequencer.tree, Time=program_sequencer.result, Normalized=True)  # -> SystemMeshes, JointRotations, Plane, Index, Time, Program, Errors

# ---- group: Control Buttons
toggle_simulation_remote = BooleanToggle(False)
upload = Button()
play = Button()
pause = Button()

# ---- group: Button OR Prog Stopped
gate_or = GateOr(A=equality.Equality, B=upload)
event_gate = EventGate(Data=gate_or)  # -> Data, IsNew
panel_3 = Panel(event_gate.Data)

# ---- group: Sequencial Program Incrementation
list_indices_2 = ListIndices(List=create_program.Program)
merge_2 = Merge(Data1="-1", Data2=list_indices_2)
stream_freeze_gate = StreamFreezeGate(Data=merge_2, PassingSwitch=toggle_simulation_remote, Freeze=False)
oilcan = OilCan(DataList=stream_freeze_gate, Reset=upload, Drop=event_gate.Data, DropMode=2)
list_item_4 = ListItem(List=create_program.Program, Index=oilcan, Wrap=False)

# ---- group: Show next target
list_item_5 = ListItem(List=urrtde_client.A, Index=56, Wrap=True)
get_value_from_string_2 = Python3Script(string=list_item_5)  # -> Integer; inputs string: list of String; same code as get_value_from_string
difference = Panel("9")
holding_gate = HoldingGate(Data=oilcan)
deconstruct_target = DeconstructTarget(Target=path_mapper)
maximum = Maximum(A=get_value_from_string_2, B=difference)
tree_branch = TreeBranch(Tree=simplify(deconstruct_target), Path=holding_gate, MaintainPaths=True)
subtraction = Subtraction(A=maximum, B=difference)
sub_list = SubList(List=tree_branch, Domain=subtraction, Wrap=True)  # -> List, Index
list_item_6 = ListItem(List=tree_branch, Index=subtraction, Wrap=False)
panel_4 = Panel(subtraction)
polyline_2 = PolyLine(Vertices=sub_list.List, Closed=False)
annotation_dot = AnnotationDot(Location=list_item_6, PrimaryText=subtraction, TextHeight=14)
point_2 = Point(list_item_6)

# ----
remote_connection = RemoteConnection(Program=list_item_4, IP=robot_ip_address, Upload=event_gate.Data, Play=play, Pause=pause)

# ---- group: Real-time Monitoring
# runtime_state Guide: 0 = Stopping / Not Running
# 1 = Stopped
# 2 = Running / Playing
# 3 = Pausing
# 4 = Paused
# 5 = Resuming
text = Text(list_item_3)
_31_runtime_state = Panel(text)
list_length = ListLength(List=create_program.Program)
text_2 = Text(list_item_5)
concatenate_2 = Concatenate(FragmentA=holding_gate, FragmentB="/", FragmentA_2=list_length, FragmentB_2=" - ", FragmentA_3=get_value_from_string_2)
_56_script_control_line = Panel(text_2)
progindex_lineindex = Panel(concatenate_2)
hh_mm_ss = Python3Script(duration=flatten(create_program.Duration))  # -> total, list_d; inputs duration: list of Double
# ---------- hh_mm_ss: Python ----------
# duration : list_d of durations in minutes (floats)
# Outputs:
# total → summed time HH:MM:SS
# list_d → each duration formatted individually HH:MM:SS

def to_hms(minutes):
    total_seconds = int(minutes * 60)
    h = total_seconds // 3600
    m = (total_seconds % 3600) // 60
    s = total_seconds % 60
    return f"{h:02d}:{m:02d}:{s:02d}"

# Format each duration
list_d = [to_hms(v) for v in duration]

# Sum durations
total_minutes = sum(duration)
total = to_hms(total_minutes)
# ---------- end hh_mm_ss ----------
total_duration = Panel(hh_mm_ss.total)
list_duration = Panel(hh_mm_ss.list_d)

# ---- group: Real-time Preview
list_item_7 = ListItem(List=urrtde_client.A, Index=10, Wrap=True)
python_3_script = Python3Script(actual_TCP_pose=list_item_7)  # -> reversed_list; inputs actual_TCP_pose: String
# ---------- python_3_script: Python ----------
# Input: "actual_TCP_pose"
# Output: "reversed_list"

data_only = actual_TCP_pose.split(":")[1] # split after text and select index [1]
parts = data_only.split(",") # split into list
values = [float(p.strip()) for p in parts] # clean extra space 
reversed_values = list(reversed(values)) #reverse to match the strcuture of the following component 
reversed_list = reversed_values # output
# ---------- end python_3_script ----------
robotsystem_parameter = RobotSystemParameter(load_robot_system)
get_plane = GetPlane(Numbers=python_3_script, RobotSystem=robotsystem_parameter)

# ---- group: Real-time Monitoring (continued)
text_3 = Text(python_3_script)
degrees = Degrees(Radians=text_3)
_10_actual_tcp_pose_formated = Panel(degrees)

# ----
create_target_3 = CreateTarget(Plane=get_plane, RobConf=list_2, Tool=create_tool.Tool, IsCartesian=True)

# ---- group: Real-time Preview (continued)
kinematics = Kinematics(RobotSystem=robotsystem_parameter, Target=create_target_3, DisplayGeometry=True)  # -> Meshes, Joints, Planes, Errors
custom_preview = CustomPreview(
    Geometry=kinematics.Meshes,
    Material={diffuse=RGB(221, 160, 221), emission=RGB(66, 48, 66), shine=0.5, specular=RGB(255, 255, 255), transparency=0})  # disabled

# ---- group: Preview
stream_filter = StreamFilter(Gate=toggle_simulation_remote, Stream0=program_simulation.SystemMeshes, Stream1=kinematics.Meshes)
simulation = ColourSwatch(SwatchColor=RGB(221, 160, 221))
real_time = ColourSwatch(SwatchColor=RGB(255, 170, 0))
stream_filter_2 = StreamFilter(Gate=toggle_simulation_remote, Stream0=simulation, Stream1=real_time)
custom_preview_2 = CustomPreview(Geometry=stream_filter, Material=stream_filter_2)

# ==== cluster ProgramSequencer
program_parameter = ClusterInput()
program_parameter_2 = ProgramParameter(program_parameter)
list_length = ListLength(List=program_parameter_2)
value = ClusterInput()
remap_numbers = RemapNumbers(Value=value, Source=Domain(0, 1), Target=list_length)  # -> Mapped, Clipped
round = Round(Number=remap_numbers.Mapped)  # -> Nearest, Floor, Ceiling
sift_indices = SiftIndices(List=program_parameter_2, Indices=round.Floor)  # -> AtI, NotI
modulus = Modulus(A=remap_numbers.Mapped, B=1)
clean_tree = CleanTree(RemoveNulls=True, RemoveInvalid=True, RemoveEmpty=True, Tree=sift_indices.AtI)
result = ClusterOutput(modulus)
tree = ClusterOutput(clean_tree)

# ==== cluster Preview
point = ClusterInput()
point_2 = Point(point)
move = Move(Geometry=point_2, Motion=Vector(0, 0, 20))  # -> Geometry, Transform
annotation_dot = AnnotationDot(Location=move.Geometry, PrimaryText="Home", TextHeight=14)  # -> AnnotationDot, Location, PrimaryText, TextHeight
annotation_dot_2 = ClusterOutput(annotation_dot.AnnotationDot)
