# Grasshopper definition UR_Printing_Cue_Loop_Update.gh (Grasshopper 1.0.8)
# plug-ins: Heteroptera, Robots, Pufferfish, Human

# ----
# UR Printing Cue Loop
# Split a toolpath into multiple programs of a selected
# length and upload them sequencially by checking
# the robot's runtime_state through RTDE connection.
# The user can easily toggle between simulation
# view and remote control.
# Robot System
list = RobotsLibrary(
    {"Fanuc-M900iB/700", "Franka Emika Panda", "Bartlett-IRB120", "Bartlett-IRB1600", "Bartlett-KR6", "Bartlett-KR60-A", "Bartlett-KR60-B", "Bartlett-KR500", "Bartlett-KR60 on track", "Bartlett-UR10", "Bartlett-KR60", "Bartlett-TX200", "Bartlett-TX200L", "Bartlett-RX160", "Bartlett-RX160L", "UR3e", "UR5e", "UR10e", "UR16e", "UR3", "UR5", "UR10", "UR20", "UR30"}, selected="UR10e",
    Type=0)
load_robot_system = LoadRobotSystem(Name=list, Base=PlaneXY(0, 0, 0))
robot_ip_address = Panel("192.168.1.141")

# ---- group: Target Config
create_tool = CreateTool(Name="Probe", TCP=PlaneXY(0, 0, 80), Weight=0, Mesh=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)  # -> Tool, TCP
list_2 = FlagFields({"Shoulder": 1, "Elbow": 2, "Wrist": 4}, selected=[])
speed_parameter = SpeedParameter(Slider(50, range=0..100))
zone_parameter = ZoneParameter(Slider(1, range=0..10))

# ---- group: Toolpath
brep = Brep(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)
number_slider = Slider(2, range=0..100)
contour = Contour(Shape=brep, Point=Point(0, 0, 0), Direction=Vector(0, 0, 1), Distance=number_slider)
divide_length = DivideLength(Curve=contour, Length=number_slider)  # -> flatten(Points), Tangents, Parameters
flip_plane = FlipPlane(Plane=divide_length.Points, ReverseX=False, ReverseY=False, SwapAxes=True)
polyline = PolyLine(Vertices=divide_length.Points, Closed=False)
custom_preview_lineweights = CustomPreviewLineweights(
    Geometry=polyline,
    Shader={diffuse=RGB(221, 160, 221), emission=RGB(66, 48, 66), shine=0.5, specular=RGB(255, 255, 255), transparency=0},
    Absolute=False)

# ----
cue_size = Slider(1000, range=0..2000)

# ---- group: Partition Target + Extrusion Start & Stop
partition_list = PartitionList(List=flip_plane, Size=cue_size)
list_item = ListItem(List=partition_list, Index=0, Wrap=True)
list_item_2 = ListItem(List=partition_list, Index=-1, Wrap=True)
create_target = CreateTarget(
    Plane=partition_list,
    RobConf=list_2,
    Tool=create_tool.Tool,
    Speed=speed_parameter,
    Zone=zone_parameter,
    IsCartesian=True)
start = CreateTarget(Plane=list_item, RobConf=list_2, Tool=create_tool.Tool, Speed=speed_parameter, Zone=zone_parameter, IsCartesian=True)
stop = CreateTarget(Plane=list_item_2, RobConf=list_2, Tool=create_tool.Tool, Speed=speed_parameter, Zone=zone_parameter, IsCartesian=True)
merge = Merge(Data1=start, Data2=stop)
panel = Panel("""0
-1""")
insert_items = InsertItems(List=create_target, Item=merge, Indices=panel, Wrap=True)

# ----
boolean_toggle = BooleanToggle(False)
boolean_toggle_2 = BooleanToggle(False)

# ---- group: Home Position (Beginning & End)
home = Plane(Plane(origin=(30.00004871, -807.3883541, 605), x=(0, 1, 0), y=(1, 0, 0)))
point = Point(home)
preview = Preview(point=point)
create_target_2 = CreateTarget(Plane=home, RobConf=list_2, Tool=create_tool.Tool, Speed=speed_parameter, Zone=zone_parameter, IsCartesian=True)
entwine = Entwine(Branch0X=create_target_2, Branch1X=simplify(insert_items), Branch2X=create_target_2, FlattenInputs=False)  # -> simplify(Result)
path_mapper = PathMapper(entwine, source="{A;B}", target="{path_index}")

# ----
tree_statistics = TreeStatistics(Tree=path_mapper)  # -> Paths, Length, Count
list_indices = ListIndices(List=tree_statistics.Paths)
concatenate = Concatenate(FragmentA="program_", FragmentB=list_indices)
create_program = CreateProgram(Name=graft(concatenate), RobotSystem=graft(load_robot_system), Targets=simplify(path_mapper), StepSize=10)  # -> flatten(Program), Code, flatten(Duration), Warnings, Errors

# ---- group: URTDE Client
# RTDE Client
urrtde_variables = CSharpScript()  # -> A
# ---------- urrtde_variables: C# ----------
// Grasshopper Script Instance
#region Usings

#r "C:\Users\celso\AppData\Roaming\McNeel\Rhinoceros\packages\8.0\Robots\1.9.0\Robots.dll"
using System;
using System.Linq;
using System.Collections;
using System.Collections.Generic;
using System.Drawing;

using Rhino;
using Rhino.Geometry;

using Grasshopper;
using Grasshopper.Kernel;
using Grasshopper.Kernel.Data;
using Grasshopper.Kernel.Types;

using Robots;
#endregion

public class Script_Instance : GH_ScriptInstance
{
    private void RunScript(ref object A)
    {

        A = URRealTimeDataExchange.GetAllVariables()
                                .Select(v => v.Name)
                                .ToList();
    }
}
# ---------- end urrtde_variables ----------
panel_2 = Panel("""0 to 55
78 to 78""")
subset = SubList(List=urrtde_variables, Domain=panel_2, Wrap=False)  # -> flatten(List), Index
trigger = Trigger(Interval=10, TimerInterval=10, Target=urrtde_client)  # disabled
urrtde_client = CSharpScript(IP=robot_ip_address, N=subset.List)  # -> A, B; inputs IP: String, N: list of String
# ---------- urrtde_client: C# ----------
// Grasshopper Script Instance
#region Usings

#r "C:\Users\celso\AppData\Roaming\McNeel\Rhinoceros\packages\8.0\Robots\1.9.0\Robots.dll"
using System;
using System.Linq;
using System.Collections;
using System.Collections.Generic;
using System.Drawing;

using Rhino;
using Rhino.Geometry;

using Grasshopper;
using Grasshopper.Kernel;
using Grasshopper.Kernel.Data;
using Grasshopper.Kernel.Types;

using Robots;
#endregion

public class Script_Instance : GH_ScriptInstance
{
    private void RunScript(string IP, List<string> N, ref object A, ref object B)
    {
    A = null;     // safe default
    B = null;     // (optional but clean)

    if(_ip != IP)
    {
        _ip = IP;
        Dispose();
    }

    try
    {
        if(_client == null)
        _client = new URRealTimeDataExchange(IP, N);

        _client.ReadOutputs();

        A = _client.Outputs
        .Select(o => $"{o.Name}: {string.Join(", ", o.Values.Select(v => v.ToString("0.###")))}")
        .ToList();

        B = _client.Log;
    }
    catch(Exception e)
    {
        Dispose();
        B = e.Message;
    }
    }


  // <Custom additional code> 
  string _ip;
  URRealTimeDataExchange _client = null;

  void Dispose()
  {
    if(_client != null)
      _client.Dispose();

    _client = null;
  }

  // </Custom additional code> 
}
# ---------- end urrtde_client ----------

# ----
program_sequencer = ProgramSequencer(program_parameter=create_program.Program, value=Slider(0, range=0..0.9999))  # -> tree, result
list_item_3 = ListItem(List=urrtde_client.A, Index=39, Wrap=True)

# ---- group: Check If Program Is Stopped
list_item_4 = ListItem(List=urrtde_client.A, Index=31, Wrap=True)
get_value_from_string = Python3Script(string=list_item_4)  # -> Integer; inputs string: list of String
# ---------- get_value_from_string: Python ----------
# Input: string (can be a single string or list of strings)
# Output: Integer (single integer or list of integers)

def extract_int(s):
    data_only = s.split(":")[1]          # split and take the part after ':'
    return int(data_only.strip())        # convert to integer

if isinstance(string, list):             # if input is list
    Integer = [extract_int(s) for s in string]
else:                                    # if input is single string
    Integer = extract_int(string)
# ---------- end get_value_from_string ----------

# ----
program_simulation = ProgramSimulation(Program=program_sequencer.tree, Time=program_sequencer.result, Normalized=True)  # -> SystemMeshes, JointRotations, Plane, Index, Time, Program, Errors

# ---- group: Control Buttons
toggle_simulation_remote = BooleanToggle(True)
upload = Button()
pause = Button()
resume = Button()

# ----
remote_sequence = CSharpScript(
    IP=robot_ip_address,
    Programs=create_program.Program,
    RuntimeState=get_value_from_string,
    Upload=upload,
    Pause=pause,
    Resume=resume,
    FreeDrive=False)  # -> Status, Index, ID, Log; inputs IP: String, Programs: list, RuntimeState: Int32, Upload: Boolean, Pause: Boolean, Resume: Boolean, FreeDrive: Boolean
# ---------- remote_sequence: C# ----------
// Grasshopper Script Instance
#region Usings
using System;
using System.Collections.Generic;
using System.Net.Sockets;
using System.Text;
using System.Threading;

using Rhino;
using Rhino.Geometry;

using Grasshopper;
using Grasshopper.Kernel;
#endregion

public class Script_Instance : GH_ScriptInstance
{
  // Ports
  const int SECONDARY_PORT = 30002;
  const int DASHBOARD_PORT = 29999;

  // Your mapping: runtime_state == 1 means STOPPED
  const int STOPPED_VALUE = 1;

  // Timing
  const int CONNECT_TIMEOUT_MS = 1500;
  const int POLL_MS = 40;                 // RTDE polling gate
  const int START_TIMEOUT_MS = 3000;      // wait for "not stopped" after send
  const int STOP_SETTLE_TIMEOUT_MS = 5000;
  const int POST_STOP_SETTLE_MS = 200;

  // Debounce: require "stopped" stable before sending next
  const int STOPPED_STABLE_MS = 200;

  // Retry behavior for flaky starts
  const int START_RETRIES = 2;            // after first send, retry up to 2 times
  const int RETRY_BACKOFF_MS = 250;

  // FreeDrive handshake
  const int FREEDRIVE_WAIT_NOTRUNNING_MS = 2000;
  const int FREEDRIVE_WAIT_RUNNING_MS = 1200;

  // Edge memory
  bool prevUpload = false;
  bool prevPause  = false;
  bool prevResume = false;
  bool prevFreeDrive = false;

  // Persistent log + UI state
  List<string> persistentLog = new List<string>();
  string lastStatus = "Idle.";
  int lastIndex = -1;
  string lastName = "";

  // Sequencer state
  Thread worker = null;
  volatile bool seqRunning = false;
  volatile bool seqPauseRequested = false;
  volatile bool seqStopRequested = false;

  volatile bool seqFailed = false;
  volatile string seqFailReason = "";

  // Live RTDE state (updated by RunScript each GH solution)
  volatile int latestRuntimeState = STOPPED_VALUE;

  // Snapshot of programs for the running sequence
  List<object> seqPrograms = null;

  // FreeDrive state
  volatile bool freeDriveActive = false;

  private void RunScript(
		string IP,
		List<object> Programs,
		int RuntimeState,
		bool Upload,
		bool Pause,
		bool Resume,
		bool FreeDrive,
		ref object Status,
		ref object Index,
		ref object ID,
		ref object Log)
  {
    // Always update latest RTDE state (worker watches this)
    latestRuntimeState = RuntimeState;

    bool uploadEdge = Upload && !prevUpload;
    bool pauseEdge  = Pause && !prevPause;
    bool resumeEdge = Resume && !prevResume;

    bool freeDriveOnEdge  = FreeDrive && !prevFreeDrive;
    bool freeDriveOffEdge = !FreeDrive && prevFreeDrive;

    if (string.IsNullOrWhiteSpace(IP))
    {
      lastStatus = "IP not set.";
      SetOutputs(ref Status, ref Index, ref ID, ref Log);
      prevUpload = Upload; prevPause = Pause; prevResume = Resume; prevFreeDrive = FreeDrive;
      return;
    }

    // -------------------- FreeDrive toggle handling (robust handshake) --------------------
    try
    {
      if (freeDriveOnEdge)
      {
        Add("FREEDRIVE ON edge -> start freedrive holder program (with handshake)");
        freeDriveActive = true;

        // Best-effort: stop any sequencer thread
        if (seqRunning)
        {
          Add("FREEDRIVE -> stopping existing sequence...");
          seqStopRequested = true;
        }

        // Best-effort pause whatever is running (safer)
        try
        {
          SendSecondaryRobust(IP, "pause program");
          Add("FREEDRIVE -> pause program sent");
        }
        catch (Exception ex)
        {
          Add("FREEDRIVE -> pause program failed (continuing): " + ex.Message);
        }

        // Wait until dashboard says running=false (settle), but don't hard-fail if it times out
        bool becameNotRunning = WaitDashboardRunning(IP, false, FREEDRIVE_WAIT_NOTRUNNING_MS);
        Add("FREEDRIVE -> wait running=false : " + (becameNotRunning ? "OK" : "timeout"));

        Thread.Sleep(120);

        // Freedrive must be kept alive by a running program: send a holder loop
        string fdScript =
          "def GH_FREEDRIVE():\n" +
          "  freedrive_mode()\n" +
          "  while (True):\n" +
          "    sync()\n" +
          "  end\n" +
          "end\n" +
          "GH_FREEDRIVE()\n";

        SendSecondaryRobust(IP, fdScript);
        Add("FREEDRIVE -> holder sent (attempt 1)");

        // Verify it actually started; if not, resend once
        bool started = WaitDashboardRunning(IP, true, FREEDRIVE_WAIT_RUNNING_MS);
        if (!started)
        {
          Add("FREEDRIVE -> holder did not start, resending once...");
          Thread.Sleep(180);
          SendSecondaryRobust(IP, fdScript);
          Add("FREEDRIVE -> holder sent (attempt 2)");
          started = WaitDashboardRunning(IP, true, FREEDRIVE_WAIT_RUNNING_MS);
        }

        lastStatus = started
          ? "FreeDrive enabled (holder running). Toggle OFF to exit."
          : "WARNING: FreeDrive holder may not have started (check Remote / safety / pendant).";

        RequestRecompute();
      }

      if (freeDriveOffEdge)
      {
        Add("FREEDRIVE OFF edge -> stop freedrive holder");
        freeDriveActive = false;

        // Stop the holder loop program
        TryDashboard(IP, "stop", out string stopResp);
        if (!string.IsNullOrWhiteSpace(stopResp))
          Add("dashboard stop -> " + stopResp.Trim());

        // Wait for running=false (settle)
        bool becameNotRunning = WaitDashboardRunning(IP, false, 2000);
        Add("FREEDRIVE -> wait running=false after stop : " + (becameNotRunning ? "OK" : "timeout"));

        // Best-effort cleanup
        try { SendSecondaryRobust(IP, "end_freedrive_mode()"); }
        catch { /* ignore */ }

        lastStatus = "FreeDrive disabled.";
        Add("FREEDRIVE -> disabled");
        RequestRecompute();
      }
    }
    catch (Exception ex)
    {
      Add(ex.ToString());
      lastStatus = "ERROR (FreeDrive): " + ex.Message;
      RequestRecompute();
    }

    // While FreeDrive active, block sequencing controls (avoid fighting the holder loop)
    if (freeDriveActive)
    {
      if (uploadEdge) Add("UPLOAD edge ignored because FreeDrive is ON.");
      if (pauseEdge)  Add("PAUSE edge ignored because FreeDrive is ON.");
      if (resumeEdge) Add("RESUME edge ignored because FreeDrive is ON.");

      SetOutputs(ref Status, ref Index, ref ID, ref Log);

      prevUpload = Upload;
      prevPause  = Pause;
      prevResume = Resume;
      prevFreeDrive = FreeDrive;
      return;
    }
    // ----------------------------------------------------------------------

    // Pause/Resume can be sent anytime (when not in FreeDrive)
    try
    {
      if (pauseEdge)
      {
        Add("PAUSE edge -> pause program");
        seqPauseRequested = true;
        SendSecondaryRobust(IP, "pause program");
        lastStatus = "Pause sent.";
        RequestRecompute();
      }

      if (resumeEdge)
      {
        Add("RESUME edge -> resume program");
        seqPauseRequested = false;
        SendSecondaryRobust(IP, "resume program");
        lastStatus = "Resume sent.";
        RequestRecompute();
      }
    }
    catch (Exception ex)
    {
      Add(ex.ToString());
      lastStatus = "ERROR: " + ex.Message;
      RequestRecompute();
    }

    // Upload edge: (re)start sequence
    if (uploadEdge)
    {
      try
      {
        if (Programs == null || Programs.Count == 0)
          throw new Exception("Programs list is empty (provide a flattened list).");

        // Stop any existing worker
        if (seqRunning)
        {
          Add("UPLOAD edge -> stopping existing sequence...");
          seqStopRequested = true;
          TryDashboard(IP, "stop", out _);
        }

        // Reset run flags/UI state
        seqFailed = false;
        seqFailReason = "";
        lastIndex = -1;
        lastName = "";
        lastStatus = "Sequence starting...";
        RequestRecompute();

        // Snapshot list for this run
        seqPrograms = new List<object>(Programs);
        seqStopRequested = false;
        seqPauseRequested = false;

        // Start worker
        worker = new Thread(() => SequenceWorker(IP));
        worker.IsBackground = true;
        seqRunning = true;
        worker.Start();

        Add($"SEQ -> started ({seqPrograms.Count} program(s))");
        lastStatus = $"Sequence started ({seqPrograms.Count} program(s)).";
        RequestRecompute();
      }
      catch (Exception ex)
      {
        Add(ex.ToString());
        lastStatus = "ERROR: " + ex.Message;
        RequestRecompute();
      }
    }

    SetOutputs(ref Status, ref Index, ref ID, ref Log);

    prevUpload = Upload;
    prevPause  = Pause;
    prevResume = Resume;
    prevFreeDrive = FreeDrive;
  }

  // ---------------------------- Worker ----------------------------

  void SequenceWorker(string ip)
  {
    try
    {
      for (int i = 0; i < seqPrograms.Count; i++)
      {
        if (seqStopRequested) break;

        // Pause gate
        while (seqPauseRequested && !seqStopRequested)
          Thread.Sleep(POLL_MS);

        if (seqStopRequested) break;

        object pObj = seqPrograms[i];
        if (pObj == null)
        {
          Add($"SEQ -> Program[{i}] is null (skip)");
          continue;
        }

        dynamic prog = pObj;

        string name;
        List<string> lines;

        try
        {
          name = (string)prog.Name;
          lines = prog.Code[0][0];
        }
        catch
        {
          Add($"SEQ -> Program[{i}] invalid (missing Name/Code) (skip)");
          continue;
        }

        if (lines == null || lines.Count == 0)
        {
          Add($"SEQ -> Program[{i}] '{name}' empty Code (skip)");
          continue;
        }

        lastIndex = i;
        lastName = name;
        lastStatus = $"Preparing [{i + 1}/{seqPrograms.Count}] {name}";
        Add($"SEQ -> [{i}] prepare '{name}'");
        RequestRecompute();

        // If robot is running, stop it first; if already stopped, don't spam stop
        if (latestRuntimeState != STOPPED_VALUE)
        {
          TryDashboard(ip, "stop", out string stopResp);
          if (!string.IsNullOrWhiteSpace(stopResp))
            Add("dashboard stop -> " + stopResp.Trim());

          // Wait until RTDE confirms stopped
          int waited = 0;
          while (latestRuntimeState != STOPPED_VALUE && !seqStopRequested && waited < STOP_SETTLE_TIMEOUT_MS)
          {
            Thread.Sleep(POLL_MS);
            waited += POLL_MS;
          }
        }

        // Require STOPPED stable for a short window (debounce)
        if (!WaitUntilStoppedStable(STOPPED_STABLE_MS))
        {
          FailRun($"STOPPED did not become stable before sending '{name}'.");
          break;
        }

        Thread.Sleep(POST_STOP_SETTLE_MS);

        string script = string.Join("\n", lines);

        // Send + verify start (with retries + recovery)
        bool ok = SendAndConfirmStart(ip, name, script);
        if (!ok)
        {
          // fail reason already set inside
          break;
        }

        // Wait for finish: runtime_state returns to STOPPED
        lastStatus = $"Running [{i + 1}/{seqPrograms.Count}] {name}";
        RequestRecompute();

        WaitUntilRuntimeStopped();

        Add($"SEQ -> finished '{name}'");
        lastStatus = $"Finished [{i + 1}/{seqPrograms.Count}] {name}";
        RequestRecompute();
      }

      if (seqFailed)
      {
        Add("SEQ -> failed");
        // lastStatus already set by FailRun
      }
      else if (!seqStopRequested)
      {
        lastStatus = "Sequence complete.";
        Add("SEQ -> complete");
      }
      else
      {
        lastStatus = "Sequence stopped.";
        Add("SEQ -> stopped");
      }

      RequestRecompute();
    }
    catch (Exception ex)
    {
      Add(ex.ToString());
      FailRun("SEQ ERROR: " + ex.Message);
      RequestRecompute();
    }
    finally
    {
      seqRunning = false;
    }
  }

  bool SendAndConfirmStart(string ip, string name, string script)
  {
    for (int attempt = 0; attempt <= START_RETRIES; attempt++)
    {
      if (seqStopRequested) return false;

      lastStatus = $"Sending [{lastIndex + 1}/{seqPrograms.Count}] {name} (attempt {attempt + 1}/{START_RETRIES + 1})";
      Add($"SEQ -> send '{name}' (attempt {attempt + 1}/{START_RETRIES + 1})");
      RequestRecompute();

      SendSecondaryRobust(ip, script);

      lastStatus = $"Waiting start [{lastIndex + 1}/{seqPrograms.Count}] {name}";
      RequestRecompute();

      bool started = WaitUntilRuntimeNotStopped(START_TIMEOUT_MS);
      if (started) return true;

      // Not started: log dashboard state for diagnosis
      TryDashboard(ip, "robotmode", out string rm);
      TryDashboard(ip, "programState", out string ps);
      TryDashboard(ip, "running", out string rr);
      Add($"SEQ -> start FAIL '{name}' (rtde stayed {STOPPED_VALUE}). robotmode={rm.Trim()} programState={ps.Trim()} running={rr.Trim()}");

      // Recovery actions (best-effort)
      TryDashboard(ip, "close popup", out _);
      TryDashboard(ip, "unlock protective stop", out _);

      // Give the controller time to settle before retry
      Thread.Sleep(RETRY_BACKOFF_MS);

      // Ensure STOPPED stable before retrying
      WaitUntilStoppedStable(STOPPED_STABLE_MS);
    }

    FailRun($"'{name}' did not start after {START_RETRIES + 1} attempt(s).");
    return false;
  }

  bool WaitUntilStoppedStable(int stableMs)
  {
    int stable = 0;
    while (!seqStopRequested)
    {
      while (seqPauseRequested && !seqStopRequested)
        Thread.Sleep(POLL_MS);

      if (seqStopRequested) return false;

      if (latestRuntimeState == STOPPED_VALUE)
      {
        stable += POLL_MS;
        if (stable >= stableMs) return true;
      }
      else
      {
        stable = 0;
      }

      Thread.Sleep(POLL_MS);
    }
    return false;
  }

  bool WaitUntilRuntimeNotStopped(int timeoutMs)
  {
    int waited = 0;
    while (!seqStopRequested && waited < timeoutMs)
    {
      while (seqPauseRequested && !seqStopRequested)
        Thread.Sleep(POLL_MS);

      if (seqStopRequested) return false;

      if (latestRuntimeState != STOPPED_VALUE)
        return true;

      Thread.Sleep(POLL_MS);
      waited += POLL_MS;
    }
    return false;
  }

  void WaitUntilRuntimeStopped()
  {
    while (!seqStopRequested)
    {
      while (seqPauseRequested && !seqStopRequested)
        Thread.Sleep(POLL_MS);

      if (seqStopRequested) return;

      if (latestRuntimeState == STOPPED_VALUE)
        return;

      Thread.Sleep(POLL_MS);
    }
  }

  void FailRun(string reason)
  {
    seqFailed = true;
    seqFailReason = reason ?? "";
    lastStatus = "SEQUENCE FAILED: " + seqFailReason;
    Add(lastStatus);
    RequestRecompute();
  }

  // -------------------- GH UI refresh --------------------

  void RequestRecompute()
  {
    if (GrasshopperDocument != null && Component != null)
      GrasshopperDocument.ScheduleSolution(1, doc => Component.ExpireSolution(false));
  }

  // -------------------- Networking --------------------

  void SendSecondaryRobust(string ip, string message)
  {
    Exception last = null;
    for (int i = 0; i < 3; i++)
    {
      try
      {
        SendSecondary(ip, message);
        return;
      }
      catch (Exception ex)
      {
        last = ex;
        Add($"30002 send failed ({i + 1}/3): {ex.Message}");
        Thread.Sleep(150);
      }
    }
    throw new Exception("30002 send failed after retries.", last);
  }

  void SendSecondary(string ip, string message)
  {
    using (var client = new TcpClient())
    {
      client.ReceiveTimeout = CONNECT_TIMEOUT_MS;
      client.SendTimeout = CONNECT_TIMEOUT_MS;
      client.Connect(ip, SECONDARY_PORT);

      using (var stream = client.GetStream())
      {
        if (!message.EndsWith("\n")) message += "\n";
        byte[] buf = Encoding.ASCII.GetBytes(message);
        stream.Write(buf, 0, buf.Length);
      }
    }
  }

  bool TryDashboard(string ip, string cmd, out string response)
  {
    response = "";
    try
    {
      using (var client = new TcpClient())
      {
        client.ReceiveTimeout = CONNECT_TIMEOUT_MS;
        client.SendTimeout = CONNECT_TIMEOUT_MS;
        client.Connect(ip, DASHBOARD_PORT);

        using (var stream = client.GetStream())
        {
          ReadLine(stream); // greeting
          byte[] buf = Encoding.ASCII.GetBytes(cmd + "\n");
          stream.Write(buf, 0, buf.Length);
          response = ReadLine(stream);
          return true;
        }
      }
    }
    catch { return false; }
  }

  string ReadLine(NetworkStream stream)
  {
    var sb = new StringBuilder();
    int start = Environment.TickCount;

    while (true)
    {
      if (stream.DataAvailable)
      {
        int b = stream.ReadByte();
        if (b < 0 || b == '\n') break;
        if (b != '\r') sb.Append((char)b);
      }
      else
      {
        Thread.Sleep(10);
        if (Environment.TickCount - start > CONNECT_TIMEOUT_MS) break;
      }
    }
    return sb.ToString();
  }

  // -------------------- FreeDrive handshake helpers --------------------

  bool IsDashboardRunningTrue(string resp)
  {
    if (resp == null) return false;
    resp = resp.ToLowerInvariant();
    return resp.Contains("true");
  }

  bool WaitDashboardRunning(string ip, bool wantRunning, int timeoutMs)
  {
    int waited = 0;
    const int step = 80;
    while (waited < timeoutMs)
    {
      if (TryDashboard(ip, "running", out string rr))
      {
        bool isRunning = IsDashboardRunningTrue(rr);
        if (isRunning == wantRunning) return true;
      }
      Thread.Sleep(step);
      waited += step;
    }
    return false;
  }

  // -------------------- Logging + outputs --------------------

  void Add(string msg)
  {
    persistentLog.Insert(0, $"{DateTime.Now:HH:mm:ss} {msg}");
    if (persistentLog.Count > 2000) persistentLog.RemoveRange(2000, persistentLog.Count - 2000);
  }

  void SetOutputs(ref object Status, ref object Index, ref object ID, ref object Log)
  {
    Status = lastStatus;
    Index = lastIndex;
    ID = lastName;
    Log = new List<string>(persistentLog);
  }
}
# ---------- end remote_sequence ----------

# ---- group: Show next target
list_item_5 = ListItem(List=urrtde_client.A, Index=56, Wrap=True)
get_value_from_string_2 = Python3Script(string=list_item_5)  # -> Integer; inputs string: list of String; same code as get_value_from_string
difference = Panel("9")
holding_gate = HoldingGate(Data=remote_sequence.Index)
deconstruct_target = DeconstructTarget(Target=path_mapper)
maximum = Maximum(A=get_value_from_string_2, B=difference)
tree_branch = TreeBranch(Tree=simplify(deconstruct_target), Path=holding_gate, MaintainPaths=True)
subtraction = Subtraction(A=maximum, B=difference)
sub_list = SubList(List=tree_branch, Domain=subtraction, Wrap=True)  # -> List, Index
panel_3 = Panel(subtraction)
list_item_6 = ListItem(List=tree_branch, Index=subtraction, Wrap=False)
polyline_2 = PolyLine(Vertices=sub_list.List, Closed=False)
annotation_dot = AnnotationDot(Location=list_item_6, PrimaryText=subtraction, TextHeight=14)
point_2 = Point(list_item_6)

# ----
write_ao = CSharpScript(IP=robot_ip_address, Reset=pause, Resume=resume, AnalogState=list_item_3)  # -> Status, Log; inputs IP: String, Reset: Boolean, Resume: Boolean
# ---------- write_ao: C# ----------
// Grasshopper Script Instance
#region Usings
using System;
using System.Collections;
using System.Collections.Generic;
using System.Globalization;
using System.Net.Sockets;
using System.Text;
using System.Threading;

using Rhino;
using Rhino.Geometry;

using Grasshopper;
using Grasshopper.Kernel;
using Grasshopper.Kernel.Types;
#endregion

public class Script_Instance : GH_ScriptInstance
{
  const int RTDE_PORT = 30004;

  // RTDE package types
  const byte RTDE_REQUEST_PROTOCOL_VERSION        = 86; // 'V'
  const byte RTDE_CONTROL_PACKAGE_SETUP_OUTPUTS   = 79; // 'O'
  const byte RTDE_CONTROL_PACKAGE_SETUP_INPUTS    = 73; // 'I'
  const byte RTDE_CONTROL_PACKAGE_START           = 83; // 'S'
  const byte RTDE_DATA_PACKAGE                    = 85; // 'U'
  const byte RTDE_TEXT_MESSAGE                    = 77; // 'M'

  // UR analog out range (0..10V -> ratio 0..1)
  const double AO_VOLT_FULL_SCALE = 10.0;

  // Fixed burst behavior (not exposed)
  const int BURST_COUNT = 1;
  const int BURST_DELAY_MS = 0;

  // Edge detection
  bool prevReset  = false;
  bool prevResume = false;

  // Persistent log/state
  List<string> persistentLog = new List<string>();
  List<string> lastStatus = new List<string> { "AO0: idle", "AO1: idle" };

  // Cached DIGITAL (unchanged)
  bool hasDigitalCache = false;
  byte cachedStdDO  = 0;   // DO0..7
  byte cachedToolDO = 0;   // ToolDO0..1

  // Cached ANALOG (tracked from AnalogState strings)
  bool hasAO0 = false;
  bool hasAO1 = false;

  double cachedAO0Volts = 0.0;
  double cachedAO1Volts = 0.0;

  double cachedAO0Ratio = 0.0; // 0..1
  double cachedAO1Ratio = 0.0; // 0..1

  private void RunScript(
		string IP,
		bool Reset,
		bool Resume,
		object AnalogState,
		ref object Status,
		ref object Log)
  {
    bool resetEdge  = Reset && !prevReset;
    bool resumeEdge = Resume && !prevResume;

    if (string.IsNullOrWhiteSpace(IP))
    {
      lastStatus = BuildStatus("IP not set.");
      Status = new List<string>(lastStatus);
      Log = new List<string>(persistentLog);
      prevReset = Reset; prevResume = Resume;
      return;
    }

    // Block computation unless a toggle edge happened
    if (!resetEdge && !resumeEdge)
    {
      Status = new List<string>(lastStatus);
      Log = new List<string>(persistentLog);
      prevReset = Reset; prevResume = Resume;
      return;
    }

    try
    {
      if (resetEdge)
      {
        int found = ParseAndCacheAnalog(AnalogState);

        if (found == 0)
          Add("RESET edge -> WARNING: no analog lines parsed (expect e.g. 'standard_analog_output0: 2.5').");

        Add($"RESET edge -> snapshot DIGITAL + force tracked AO to 0V (force voltage mode). Tracked: AO0={(hasAO0 ? cachedAO0Volts.ToString("0.###") + "V" : "-")}, AO1={(hasAO1 ? cachedAO1Volts.ToString("0.###") + "V" : "-")}");

        DoRtdeTransaction(
          ip: IP,
          snapshotDigital: true,
          restoreDigital: false,
          forceVoltage: true,
          setAnalogToZero: true,
          restoreAnalogFromCache: false
        );

        lastStatus = BuildStatus("Reset sent (DO->0, AO->0V).");
      }

      if (resumeEdge)
      {
        if (!hasDigitalCache)
          Add("RESUME edge -> WARNING: no cached DIGITAL snapshot (press Reset once first). Will still restore analog if cached.");

        if (!hasAO0 && !hasAO1)
          Add("RESUME edge -> WARNING: no cached analog channels (nothing to restore).");

        Add($"RESUME edge -> restore DIGITAL + restore tracked AO from cache (force voltage mode). AO0={(hasAO0 ? cachedAO0Volts.ToString("0.###") + "V" : "-")}, AO1={(hasAO1 ? cachedAO1Volts.ToString("0.###") + "V" : "-")}");

        DoRtdeTransaction(
          ip: IP,
          snapshotDigital: false,
          restoreDigital: true,
          forceVoltage: true,
          setAnalogToZero: false,
          restoreAnalogFromCache: true
        );

        lastStatus = BuildStatus("Resume sent (restore cached).");
      }
    }
    catch (Exception ex)
    {
      Add("ERROR: " + ex.Message);
      Add(ex.ToString());
      lastStatus = BuildStatus("ERROR: " + ex.Message);
    }

    Status = new List<string>(lastStatus);
    Log = new List<string>(persistentLog);

    prevReset = Reset;
    prevResume = Resume;
  }

  List<string> BuildStatus(string suffix)
  {
    string s0 = hasAO0
      ? $"AO0: cached {cachedAO0Volts:0.###} V (ratio {cachedAO0Ratio:0.###}) | {suffix}"
      : $"AO0: not tracked | {suffix}";

    string s1 = hasAO1
      ? $"AO1: cached {cachedAO1Volts:0.###} V (ratio {cachedAO1Ratio:0.###}) | {suffix}"
      : $"AO1: not tracked | {suffix}";

    return new List<string> { s0, s1 };
  }

  // ---------------- Core RTDE transaction ----------------

  void DoRtdeTransaction(string ip, bool snapshotDigital, bool restoreDigital, bool forceVoltage, bool setAnalogToZero, bool restoreAnalogFromCache)
  {
    using (var client = new TcpClient())
    {
      client.NoDelay = true;
      client.ReceiveTimeout = 2500;
      client.SendTimeout = 2500;
      client.Connect(ip, RTDE_PORT);

      using (var stream = client.GetStream())
      {
        RequestProtocolVersion(stream, 2);

        // OUTPUT recipe: minimal
        SetupOutputs(stream, 125.0, new string[]
        {
          "runtime_state",
          "actual_digital_output_bits"
        });

        // INPUT recipe: DO + AO0 + AO1 + type
        var inputFields = new string[]
        {
          "standard_digital_output_mask",
          "standard_digital_output",
          "tool_digital_output_mask",
          "tool_digital_output",
          "standard_analog_output_mask",
          "standard_analog_output_type",
          "standard_analog_output_0",
          "standard_analog_output_1"
        };

        byte inputRecipeId = SetupInputs(stream, inputFields);
        Add("RTDE input recipe id = " + inputRecipeId);

        StartRtde(stream);

        // Snapshot digital outputs (unchanged)
        if (snapshotDigital)
        {
          var snap = ReadOneDataPackage(stream);
          if (snap.hasData)
          {
            ulong bits = snap.actualDigitalOutputBits;
            cachedStdDO  = (byte)(bits & 0xFF);
            cachedToolDO = (byte)((bits >> 16) & 0x03);
            hasDigitalCache = true;
            Add($"Snapshot DIGITAL: stdDO=0x{cachedStdDO:X2}, toolDO=0x{cachedToolDO:X2}");
          }
          else
          {
            hasDigitalCache = false;
            Add("Snapshot DIGITAL FAILED: did not receive RTDE data package.");
          }
        }

        // Digital values
        byte stdDoMask  = 0xFF;
        byte toolDoMask = 0x03;

        byte stdDoVal, toolDoVal;
        if (restoreDigital && hasDigitalCache)
        {
          stdDoVal  = cachedStdDO;
          toolDoVal = cachedToolDO;
        }
        else
        {
          stdDoVal  = 0x00;
          toolDoVal = 0x00;
        }

        // Analog mask/type/value
        byte aoMask = 0x00;
        if (hasAO0) aoMask |= 0x01;
        if (hasAO1) aoMask |= 0x02;

        byte aoType = 0x00;
        if (forceVoltage)
        {
          if (hasAO0) aoType |= 0x01;
          if (hasAO1) aoType |= 0x02;
        }

        double ao0 = 0.0;
        double ao1 = 0.0;

        if (restoreAnalogFromCache)
        {
          ao0 = hasAO0 ? cachedAO0Ratio : 0.0;
          ao1 = hasAO1 ? cachedAO1Ratio : 0.0;
        }
        else if (setAnalogToZero)
        {
          ao0 = 0.0;
          ao1 = 0.0;
        }

        ao0 = Clamp01(ao0);
        ao1 = Clamp01(ao1);

        Add($"Sending {BURST_COUNT} packet(s): stdDO=0x{stdDoVal:X2}, toolDO=0x{toolDoVal:X2}, AOmask=0x{aoMask:X2}, AOtype=0x{aoType:X2}, AO0={ao0:0.###}, AO1={ao1:0.###}");

        for (int i = 0; i < BURST_COUNT; i++)
        {
          SendInputData(stream, inputRecipeId,
            stdDoMask, stdDoVal,
            toolDoMask, toolDoVal,
            aoMask, aoType,
            ao0, ao1);

          DrainSome(stream, 1);
          if (BURST_DELAY_MS > 0) Thread.Sleep(BURST_DELAY_MS);
        }

        Add("RTDE transaction done.");
      }
    }
  }

  // ---------------- Parse and cache analog strings ----------------

  int ParseAndCacheAnalog(object analogState)
  {
    // Reset tracking flags on each Reset edge
    hasAO0 = false;
    hasAO1 = false;

    int count = 0;

    foreach (string line in EnumerateStrings(analogState))
    {
      if (string.IsNullOrWhiteSpace(line)) continue;

      string s = line.Trim();
      string lower = s.ToLowerInvariant();

      int ch = -1;
      if (lower.StartsWith("standard_analog_output0")) ch = 0;
      else if (lower.StartsWith("standard_analog_output1")) ch = 1;
      else continue;

      int colon = s.IndexOf(':');
      if (colon < 0) continue;

      string rhs = s.Substring(colon + 1).Trim();

      if (!double.TryParse(rhs, NumberStyles.Any, CultureInfo.InvariantCulture, out double volts))
      {
        if (!double.TryParse(rhs, out volts))
          continue;
      }

      double ratio = VoltsToRatio(volts);

      if (ch == 0)
      {
        hasAO0 = true;
        cachedAO0Volts = volts;
        cachedAO0Ratio = ratio;
        Add($"Parsed AO0: {cachedAO0Volts:0.###} V -> ratio {cachedAO0Ratio:0.###}");
        count++;
      }
      else
      {
        hasAO1 = true;
        cachedAO1Volts = volts;
        cachedAO1Ratio = ratio;
        Add($"Parsed AO1: {cachedAO1Volts:0.###} V -> ratio {cachedAO1Ratio:0.###}");
        count++;
      }
    }

    return count;
  }

  IEnumerable<string> EnumerateStrings(object x)
  {
    if (x == null) yield break;

    if (x is IGH_Goo goo)
    {
      object sv = goo.ScriptVariable();
      if (sv != null && !(sv is IGH_Goo))
      {
        foreach (var s in EnumerateStrings(sv)) yield return s;
      }
      else
      {
        yield return goo.ToString();
      }
      yield break;
    }

    if (x is string one)
    {
      yield return one;
      yield break;
    }

    if (x is IEnumerable en && !(x is string))
    {
      foreach (var item in en)
      {
        foreach (var s in EnumerateStrings(item)) yield return s;
      }
      yield break;
    }

    yield return x.ToString();
  }

  double VoltsToRatio(double volts)
  {
    if (double.IsNaN(volts)) volts = 0.0;
    return Clamp01(volts / AO_VOLT_FULL_SCALE);
  }

  double Clamp01(double x)
  {
    if (double.IsNaN(x)) return 0.0;
    if (x < 0.0) return 0.0;
    if (x > 1.0) return 1.0;
    return x;
  }

  // ---------------- RTDE protocol ----------------

  void RequestProtocolVersion(NetworkStream stream, ushort version)
  {
    var payload = new byte[2];
    WriteUInt16BE(payload, 0, version);
    WritePackage(stream, RTDE_REQUEST_PROTOCOL_VERSION, payload);

    var resp = ReadPackage(stream);
    if (resp.type != RTDE_REQUEST_PROTOCOL_VERSION) throw new Exception("RTDE: invalid protocol version response type");
    if (resp.payload.Length < 1) throw new Exception("RTDE: protocol version response too short");

    bool accepted = resp.payload[0] == 1;
    Add("RTDE protocol v" + version + " -> " + (accepted ? "accepted" : "denied"));
    if (!accepted) throw new Exception("RTDE protocol version denied. Try version 1.");
  }

  void SetupOutputs(NetworkStream stream, double frequencyHz, string[] outputs)
  {
    byte[] vars = Encoding.ASCII.GetBytes(string.Join(",", outputs));
    byte[] payload = new byte[8 + vars.Length];
    WriteDoubleBE(payload, 0, frequencyHz);
    Buffer.BlockCopy(vars, 0, payload, 8, vars.Length);

    WritePackage(stream, RTDE_CONTROL_PACKAGE_SETUP_OUTPUTS, payload);

    var resp = ReadPackage(stream);
    if (resp.type != RTDE_CONTROL_PACKAGE_SETUP_OUTPUTS) throw new Exception("RTDE: invalid setup outputs response type");

    string types = Encoding.ASCII.GetString(resp.payload, 0, resp.payload.Length);
    Add("RTDE setup outputs types: " + types);
    if (types.Contains("NOT_FOUND")) throw new Exception("RTDE: one or more output fields NOT_FOUND");
  }

  byte SetupInputs(NetworkStream stream, string[] fields)
  {
    byte[] payload = Encoding.ASCII.GetBytes(string.Join(",", fields));
    WritePackage(stream, RTDE_CONTROL_PACKAGE_SETUP_INPUTS, payload);

    var resp = ReadPackage(stream);
    if (resp.type != RTDE_CONTROL_PACKAGE_SETUP_INPUTS) throw new Exception("RTDE: invalid setup inputs response type");
    if (resp.payload.Length < 1) throw new Exception("RTDE: setup inputs response too short");

    byte recipeId = resp.payload[0];
    string types = resp.payload.Length > 1 ? Encoding.ASCII.GetString(resp.payload, 1, resp.payload.Length - 1) : "";
    Add("RTDE setup inputs types: " + types);

    if (recipeId == 0) throw new Exception("RTDE: got recipe_id 0 (setup failed?)");
    if (types.Contains("NOT_FOUND")) throw new Exception("RTDE: one or more input fields NOT_FOUND");

    return recipeId;
  }

  void StartRtde(NetworkStream stream)
  {
    WritePackage(stream, RTDE_CONTROL_PACKAGE_START, new byte[0]);
    var resp = ReadPackage(stream);
    if (resp.type != RTDE_CONTROL_PACKAGE_START) throw new Exception("RTDE: invalid start response type");
    if (resp.payload.Length < 1) throw new Exception("RTDE: start response too short");

    bool accepted = resp.payload[0] == 1;
    Add("RTDE start -> " + (accepted ? "accepted" : "denied"));
    if (!accepted) throw new Exception("RTDE start denied");
  }

  void SendInputData(NetworkStream stream, byte recipeId,
                     byte stdDoMask, byte stdDoVal,
                     byte toolDoMask, byte toolDoVal,
                     byte aoMask, byte aoType,
                     double ao0, double ao1)
  {
    var payload = new byte[1 + 6 + 8 + 8];
    int p = 0;

    payload[p++] = recipeId;

    payload[p++] = stdDoMask;
    payload[p++] = stdDoVal;
    payload[p++] = toolDoMask;
    payload[p++] = toolDoVal;
    payload[p++] = aoMask;
    payload[p++] = aoType;

    WriteDoubleBE(payload, p, ao0); p += 8;
    WriteDoubleBE(payload, p, ao1);

    WritePackage(stream, RTDE_DATA_PACKAGE, payload);
  }

  (bool hasData, uint runtimeState, ulong actualDigitalOutputBits) ReadOneDataPackage(NetworkStream stream)
  {
    int tries = 0;
    while (tries < 60)
    {
      if (!stream.DataAvailable)
      {
        Thread.Sleep(10);
        tries++;
        continue;
      }

      var resp = ReadPackage(stream);

      if (resp.type == RTDE_TEXT_MESSAGE)
      {
        string msg = Encoding.ASCII.GetString(resp.payload, 0, resp.payload.Length);
        Add("RTDE msg: " + msg);
        continue;
      }

      if (resp.type != RTDE_DATA_PACKAGE) continue;
      if (resp.payload.Length < 1 + 4 + 8) continue;

      int p = 1; // skip recipe id
      uint rs = ReadUInt32BE(resp.payload, p); p += 4;
      ulong bits = ReadUInt64BE(resp.payload, p);

      return (true, rs, bits);
    }

    return (false, 0u, 0ul);
  }

  void DrainSome(NetworkStream stream, int packets)
  {
    for (int i = 0; i < packets; i++)
    {
      if (!stream.DataAvailable) return;

      var resp = ReadPackage(stream);
      if (resp.type == RTDE_TEXT_MESSAGE)
      {
        string msg = Encoding.ASCII.GetString(resp.payload, 0, resp.payload.Length);
        Add("RTDE msg: " + msg);
      }
    }
  }

  // ---------------- Packet IO ----------------

  void WritePackage(NetworkStream stream, byte type, byte[] payload)
  {
    int length = 3 + payload.Length;
    var buf = new byte[length];
    WriteUInt16BE(buf, 0, (ushort)length);
    buf[2] = type;
    Buffer.BlockCopy(payload, 0, buf, 3, payload.Length);
    stream.Write(buf, 0, buf.Length);
  }

  (byte type, byte[] payload) ReadPackage(NetworkStream stream)
  {
    byte[] header = ReadExact(stream, 3);
    ushort length = ReadUInt16BE(header, 0);
    byte type = header[2];

    int payloadLen = length - 3;
    byte[] payload = payloadLen > 0 ? ReadExact(stream, payloadLen) : new byte[0];
    return (type, payload);
  }

  byte[] ReadExact(NetworkStream stream, int n)
  {
    byte[] buf = new byte[n];
    int read = 0;
    while (read < n)
    {
      int r = stream.Read(buf, read, n - read);
      if (r <= 0) throw new Exception("RTDE: controller stopped sending data");
      read += r;
    }
    return buf;
  }

  // ---------------- Big-endian helpers ----------------

  void WriteUInt16BE(byte[] buf, int offset, ushort v)
  {
    buf[offset + 0] = (byte)((v >> 8) & 0xFF);
    buf[offset + 1] = (byte)(v & 0xFF);
  }

  ushort ReadUInt16BE(byte[] buf, int offset)
  {
    return (ushort)((buf[offset] << 8) | buf[offset + 1]);
  }

  uint ReadUInt32BE(byte[] buf, int offset)
  {
    return (uint)((buf[offset] << 24) | (buf[offset + 1] << 16) | (buf[offset + 2] << 8) | buf[offset + 3]);
  }

  ulong ReadUInt64BE(byte[] buf, int offset)
  {
    ulong v = 0;
    for (int i = 0; i < 8; i++) v = (v << 8) | buf[offset + i];
    return v;
  }

  void WriteDoubleBE(byte[] buf, int offset, double v)
  {
    byte[] tmp = BitConverter.GetBytes(v);
    if (BitConverter.IsLittleEndian) Array.Reverse(tmp);
    Buffer.BlockCopy(tmp, 0, buf, offset, 8);
  }

  // ---------------- Logging ----------------

  void Add(string msg)
  {
    persistentLog.Insert(0, $"{DateTime.Now:HH:mm:ss} {msg}");
    if (persistentLog.Count > 1000) persistentLog.RemoveRange(1000, persistentLog.Count - 1000);
  }
}
# ---------- end write_ao ----------
panel_4 = Panel(remote_sequence.Index)
panel_5 = Panel(remote_sequence.Status)
panel_6 = Panel(remote_sequence.ID)
panel_7 = Panel(remote_sequence.Log)

# ---- group: Real-time Monitoring
# runtime_state Guide: 0 = Stopping / Not Running
# 1 = Stopped
# 2 = Running / Playing
# 3 = Pausing
# 4 = Paused
# 5 = Resuming
text = Text(list_item_4)
_31_runtime_state = Panel(text)
text_2 = Text(list_item_5)
list_length = ListLength(List=create_program.Program)  # -> expr("x-1", Length)
concatenate_2 = Concatenate(FragmentA=holding_gate, FragmentB="/", FragmentA_2=list_length, FragmentB_2=" - ", FragmentA_3=get_value_from_string_2)
_56_script_control_line = Panel(text_2)
progindex_lineindex = Panel(concatenate_2)
hh_mm_ss = Python3Script(duration=flatten(create_program.Duration))  # -> total, list_d; inputs duration: list of Double
# ---------- hh_mm_ss: Python ----------
# duration : list_d of durations in minutes (floats)
# Outputs:
# total → summed time HH:MM:SS
# list_d → each duration formatted individually HH:MM:SS

def to_hms(minutes):
    total_seconds = int(minutes * 60)
    h = total_seconds // 3600
    m = (total_seconds % 3600) // 60
    s = total_seconds % 60
    return f"{h:02d}:{m:02d}:{s:02d}"

# Format each duration
list_d = [to_hms(v) for v in duration]

# Sum durations
total_minutes = sum(duration)
total = to_hms(total_minutes)
# ---------- end hh_mm_ss ----------
total_duration = Panel(hh_mm_ss.total)
list_duration = Panel(hh_mm_ss.list_d)

# ---- group: Real-time Preview
list_item_7 = ListItem(List=urrtde_client.A, Index=10, Wrap=True)
python_3_script = Python3Script(actual_TCP_pose=list_item_7)  # -> reversed_list; inputs actual_TCP_pose: String
# ---------- python_3_script: Python ----------
# Input: "actual_TCP_pose"
# Output: "reversed_list"

data_only = actual_TCP_pose.split(":")[1] # split after text and select index [1]
parts = data_only.split(",") # split into list
values = [float(p.strip()) for p in parts] # clean extra space 
reversed_values = list(reversed(values)) #reverse to match the strcuture of the following component 
reversed_list = reversed_values # output
# ---------- end python_3_script ----------
robotsystem_parameter = RobotSystemParameter(load_robot_system)
get_plane = GetPlane(Numbers=python_3_script, RobotSystem=robotsystem_parameter)

# ---- group: Real-time Monitoring (continued)
text_3 = Text(python_3_script)
degrees = Degrees(Radians=text_3)
_10_actual_tcp_pose_formated = Panel(degrees)

# ----
create_target_3 = CreateTarget(Plane=get_plane, RobConf=list_2, Tool=create_tool.Tool, IsCartesian=True)

# ---- group: Real-time Preview (continued)
kinematics = Kinematics(RobotSystem=robotsystem_parameter, Target=create_target_3, DisplayGeometry=True)  # -> Meshes, Joints, Planes, Errors

# ---- group: Preview
stream_filter = StreamFilter(Gate=toggle_simulation_remote, Stream0=program_simulation.SystemMeshes, Stream1=kinematics.Meshes)
simulation = ColourSwatch(SwatchColor=RGB(221, 160, 221))
real_time = ColourSwatch(SwatchColor=RGB(255, 170, 0))
stream_filter_2 = StreamFilter(Gate=toggle_simulation_remote, Stream0=simulation, Stream1=real_time)
custom_preview = CustomPreview(Geometry=stream_filter, Material=stream_filter_2)

# ==== cluster ProgramSequencer
program_parameter = ClusterInput()
program_parameter_2 = ProgramParameter(program_parameter)
list_length = ListLength(List=program_parameter_2)
value = ClusterInput()
remap_numbers = RemapNumbers(Value=value, Source=Domain(0, 1), Target=list_length)  # -> Mapped, Clipped
round = Round(Number=remap_numbers.Mapped)  # -> Nearest, Floor, Ceiling
sift_indices = SiftIndices(List=program_parameter_2, Indices=round.Floor)  # -> AtI, NotI
modulus = Modulus(A=remap_numbers.Mapped, B=1)
clean_tree = CleanTree(RemoveNulls=True, RemoveInvalid=True, RemoveEmpty=True, Tree=sift_indices.AtI)
result = ClusterOutput(modulus)
tree = ClusterOutput(clean_tree)

# ==== cluster Preview
point = ClusterInput()
point_2 = Point(point)
move = Move(Geometry=point_2, Motion=Vector(0, 0, 20))  # -> Geometry, Transform
annotation_dot = AnnotationDot(Location=move.Geometry, PrimaryText="Home", TextHeight=14)  # -> AnnotationDot, Location, PrimaryText, TextHeight
annotation_dot_2 = ClusterOutput(annotation_dot.AnnotationDot)
